# Grasshopper definition GrasshopperToPython.gh (Grasshopper 1.0.7)

# 1. list
series = Series(Start=0, Step=1, Count=10)
panel = Panel(series)
# 2. points
pt = ConstructPoint(XCoordinate=series, YCoordinate=0, ZCoordinate=0)
pt_2 = ConstructPoint(XCoordinate=series, YCoordinate=Slider(10, range=0..10), ZCoordinate=0)
# 3. line
ln = Line(StartPoint=pt, EndPoint=pt_2)
# 4. divide curve
divide = DivideCurve(Curve=ln, Count=10, Kinks=False)  # -> Points, Tangents, Parameters
vec = Vector(divide.Points)
vlen = VectorLength(Vector=vec)
sin = Sine(Value=vlen)
Z = UnitZ(Factor=sin)
# 5. vector
move = Move(Geometry=divide.Points, Motion=Z)  # -> Geometry, Transform
# 6. curve
intcrv = Interpolate(Vertices=move.Geometry, Degree=3, Periodic=False, KnotStyle=1)  # -> Curve, Length, Domain
# 7. surface
loft = Loft(
    Curves=flatten(intcrv.Curve),
    Options={Adjust=False, Closed=False, LoftEnds=0, LoftSimp=0, LoftType=0, Rebuild=10, Refit=0.01})
# 8. mesh
mesh_uv = MeshSurface(Surface=loft, UCount=Slider(10, range=0..10), VCount=Slider(7, range=0..10), Overhang=True, Equalize=False)
